# Grasshopper definition e01 - Get Materials.gh (Grasshopper 1.0.7)
# plug-ins: OpenMaterials, EleFront

mesh = Mesh(graft([<mesh referenced from the Rhino model> x107]))
brep = Brep(graft([<brep referenced from the Rhino model> x4]))
get_user_value = GetUserValue(Geometry=mesh, Key="open_materials")
c_script = CSharpScript(Reference="C:\git\open_materials\bin\OpenMaterials.gha")  # -> out, A
# ---------- c_script: C# usings ----------
using OpenMaterials;
# ---------- c_script: C# ----------
    //header = {"Authorization": "Bearer" + token, "Accept": "application/vnd.github+json"};
    string repo = "data";
    string user = "opensource-construction";
    string branch = "main";

    string url = string.Format("https://api.github.com/repos/{0}/{1}/git/trees/{2}?recursive=1", user, repo, branch);

    string base_url = string.Format("https://{0}.github.io/{1}/", user, repo);


    Print(url);
    var res = OpenMaterials.WebClient.Get(url);

    Print(res);
# ---------- end c_script ----------
panel = Panel("Glass")
panel_2 = Panel(c_script.out)
thermproperties = ThermProperties(Supplier="Steve", Product=get_user_value)  # -> ThermalConductivity, SpecificHeat
mechproperties = MechProperties(Supplier="Steve", Product=get_user_value, Filters="filter")  # -> Density, ElasticModulus, PoissonRatio
merge = Merge(
    Data1=mechproperties.Density,
    Data2=mechproperties.ElasticModulus,
    Data3=mechproperties.PoissonRatio,
    Data4=thermproperties.ThermalConductivity,
    Data5=thermproperties.SpecificHeat)
list_item = ListItem(List=merge, Index=Slider(1, range=0..6), Wrap=True)
c_script_2 = CSharpScript(Values_V=flatten(list_item))  # -> out, A, B, C; inputs Values_V: list of Double
# ---------- c_script_2: C# usings ----------
using System.Linq;
# ---------- c_script_2: C# ----------
    A = V;
    B = V.Max();
    C = V.Min();
# ---------- end c_script_2 ----------
gradient = Gradient(
    LowerLimit=c_script_2.C,
    UpperLimit=c_script_2.B,
    Parameter=c_script_2.A,
    stops=[0: RGB(0, 128, 0), 0.5: RGB(255, 255, 0), 1: RGB(255, 0, 0)])
custom_preview = CustomPreview(Geometry=flatten(mesh), Material=gradient)
