# Grasshopper definition e01b - Get Materials.gh (Grasshopper 1.0.7)
# plug-ins: OpenMaterials, EleFront

c_script = CSharpScript(Reference="C:\git\open_materials\bin\OpenMaterials.gha")  # -> out, A
# ---------- c_script: C# usings ----------
using OpenMaterials;
# ---------- c_script: C# ----------
    //header = {"Authorization": "Bearer" + token, "Accept": "application/vnd.github+json"};
    string repo = "data";
    string user = "opensource-construction";
    string branch = "main";

    string url = string.Format("https://api.github.com/repos/{0}/{1}/git/trees/{2}?recursive=1", user, repo, branch);

    string base_url = string.Format("https://{0}.github.io/{1}/", user, repo);


    Print(url);
    var res = OpenMaterials.WebClient.Get(url);

    Print(res);
# ---------- end c_script ----------
mesh = Mesh(graft(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))
panel = Panel("Glass")
panel_2 = Panel(c_script.out)
get_user_value = GetUserValue(Geometry=mesh, Key="open_materials")
thermproperties = ThermProperties(Supplier="Steve", Product="Wood")  # -> ThermalConductivity, SpecificHeat
mechproperties = MechProperties(Supplier="Steve", Product="Wood", Filters=" ")  # -> Density, ElasticModulus, PoissonRatio
mechanical_properties = Panel([mechproperties.Density, mechproperties.ElasticModulus, mechproperties.PoissonRatio])
thermal_properties = Panel([thermproperties.ThermalConductivity, thermproperties.SpecificHeat])
