# Grasshopper definition e02 - Display Materials.gh (Grasshopper 1.0.7)
# plug-ins: EleFront

value_list = ValueList({"Default"}, selected="Default")
reference_by_layer = ReferenceByLayer(LayerName=value_list)
get_user_value = GetUserValue(Geometry=reference_by_layer, Key="open_materials")
panel = Panel(get_user_value)
unweld_mesh = UnweldMesh(Mesh=reference_by_layer, Angle=0.1)

property = ValueList({"Name": "material_name", "Density": "density", "Heat capacity": "Heat_capacity", "Thermal conductivity": "TC_value", "GWP": "GWP_value_A1-A3"}, selected="GWP")
open_materials = CSharpScript(
    Geometry_G=unweld_mesh,
    Json_J=get_user_value,
    Property_P=property,
    Reference="C:\Program Files\Rhino 7\System\Newtonsoft.Json.Rhino.dll")  # -> out, A; inputs Geometry_G: GeometryBase, Json_J: String, Property_P: String
# ---------- open_materials: C# usings ----------
using Newtonsoft.Json;

using Newtonsoft.Json.Linq;
# ---------- open_materials: C# ----------
    var key = P;
    var NameMap = new Dictionary<string, string>{
        {"density","Density"},
        {"material_name", "Name"},
        {"Heat_capacity", "Heat capacity"},
        {"TC_value", "Thermal conductivity"},
        {"GWP_value_A1-A3", "GWP"}
        };

    CurrentProperty = NameMap[key];

    var data = JsonConvert.DeserializeObject<Dictionary<string, object>>(J);

    if (!data.ContainsKey(key))
    {
      A = NullValue;
      return;
    }

    int index = MaterialNames.IndexOf(data["material_name"].ToString());
    if (index < 0)
    {
      MaterialNames.Add(data["material_name"].ToString());
    }


    if (key == "material_name")
    {
      index = MaterialNames.IndexOf(data[key].ToString());

      if (index < 0)
      {
        MaterialNames.Add(data[key].ToString());
        A = MaterialNames.Count - 1;
        return;

      }
      else
      {
        A = index;
        return;
      }
    }
    else
    {

      if (key == "GWP_value_A1-A3")
      {
        A = Math.Min(double.Parse(data[key].ToString()), 3.0);
      }
      else
      {
        A = data[key];
      }
    }
# ---------- open_materials: C# additional code ----------
  List<string> MaterialNames = new List<string>();
  string CurrentProperty = "";
  int NullValue = -9999;


  //Return a BoundingBox that contains all the geometry you are about to draw.
  public override BoundingBox ClippingBox
  {
    get
    {
      return BoundingBox.Empty;
    }
  }

  //Draw all meshes in this method.
  public override void DrawViewportMeshes(IGH_PreviewArgs args)
  {
    double xpos = 20;
    double ypos = 20;

    args.Display.Draw2dText("Materials", System.Drawing.Color.White,
      new Point2d(xpos, ypos), false, 30);


    ypos += 35;

    foreach (var name in MaterialNames)
    {
      args.Display.Draw2dText(name, System.Drawing.Color.White,
        new Point2d(xpos, ypos), false, 15);
      ypos += 20;
    }

    ypos += 20;
    
    args.Display.Draw2dText("Active prop", System.Drawing.Color.White,
      new Point2d(xpos, ypos), false, 25);
    ypos += 30;

    args.Display.Draw2dText(CurrentProperty, System.Drawing.Color.White,
      new Point2d(xpos, ypos), false, 20);
  }

  //Draw all wires and points in this method.
  public override void DrawViewportWires(IGH_PreviewArgs args)
  {


  }
# ---------- end open_materials ----------

c_script = CSharpScript(Geometry_G=unweld_mesh, Json_J=get_user_value, Reference="C:\Program Files\Rhino 7\System\Newtonsoft.Json.Rhino.dll")  # -> out, A; inputs Geometry_G: GeometryBase, Json_J: String
# ---------- c_script: C# ----------
    var data = JsonConvert.DeserializeObject<Dictionary<string, object>>(J);
    int index = MaterialNames.IndexOf((string) data["material_name"]);
    if (index < 0)
    {
      MaterialNames.Add((string) data["material_name"]);
      A = MaterialNames.Count - 1;
      
    }
    else
    {
      A = index;
    }
# ---------- c_script: C# additional code ----------
  List<string> MaterialNames = new List<string>();
# ---------- end c_script ----------
larger_than = LargerThan(FirstNumber=open_materials.A, SecondNumber=-1000)  # -> LargerThan, OrEqualTo
dispatch = Dispatch(List=unweld_mesh, DispatchPattern=larger_than.LargerThan)  # -> ListA, ListB
dispatch_2 = Dispatch(List=open_materials.A, DispatchPattern=larger_than.LargerThan)  # -> ListA, ListB
panel_2 = Panel(dispatch_2.ListA)
sort_list = SortList(Keys=dispatch_2.ListA)  # -> Keys, ValuesValuesA
list_item = ListItem(List=sort_list.Keys, Index=0, Wrap=True)  # -> Item1, Item
gradient = Gradient(
    LowerLimit=list_item.Item,
    UpperLimit=list_item.Item1,
    Parameter=dispatch_2.ListA,
    stops=[0: RGB(243, 57, 0), 0.1: RGB(236, 27, 60), 0.2: RGB(210, 0, 118), 0.3: RGB(103, 0, 120), 0.4: RGB(39, 72, 161), 0.5: RGB(1, 192, 229), 0.6: RGB(18, 178, 90), 0.7: RGB(79, 186, 8), 0.8: RGB(220, 237, 32), 0.9: RGB(247, 159, 20), 1: RGB(243, 57, 0)])
gradient_2 = Gradient(
    LowerLimit=list_item.Item,
    UpperLimit=list_item.Item1,
    Parameter=dispatch_2.ListA,
    stops=[0: RGB(0, 128, 0), 0.5: RGB(255, 255, 0), 1: RGB(255, 0, 0)])
create_material = CreateMaterial(Diffuse=gradient_2, Specular=RGB(255, 255, 255), Emission=RGB(0, 0, 0), Transparency=0, Shine=0)
custom_preview = CustomPreview(Geometry=dispatch.ListA, Material=create_material)
